# Grasshopper definition GameOfLife.gh (Grasshopper 1.0.8)
# plug-ins: RhinoCodePluginGH

number_slider = Slider(30, range=0..100)
trigger = Trigger(Interval=500, TimerInterval=500, Target=c_script)  # disabled
c_script = CSharpScript(reset=Button(), height=number_slider, width=number_slider, cellSize=Slider(5, range=0..10))  # -> out, a; inputs reset: Boolean, height: Int32, width: Int32, cellSize: Double
# ---------- c_script: C# ----------
// Grasshopper Script Instance
#region Usings
using System;
using System.Linq;
using System.Collections;
using System.Collections.Generic;
using System.Drawing;

using Rhino;
using Rhino.Geometry;

using Grasshopper;
using Grasshopper.Kernel;
using Grasshopper.Kernel.Data;
using Grasshopper.Kernel.Types;
#endregion

public class Script_Instance : GH_ScriptInstance
{
    #region Notes
    /* 
      Members:
        RhinoDoc RhinoDocument
        GH_Document GrasshopperDocument
        IGH_Component Component
        int Iteration

      Methods (Virtual & overridable):
        Print(string text)
        Print(string format, params object[] args)
        Reflect(object obj)
        Reflect(object obj, string method_name)
    */
    #endregion

    private void RunScript(
	bool reset,
	int height,
	int width,
	double cellSize,
	ref object a)
    {
        if (reset || simulation == null)
        {
            simulation = new LifeSimulation(height, width);
        }
        
        simulation.Update();
        
        a = simulation.GetAliveCellsAsPoints(cellSize);
    }

    public LifeSimulation simulation; 

    public class LifeSimulation
    {
        public int Height, Width;
        public bool[,] cells;

        public LifeSimulation(int Height, int Width)
        {
            this.Height = Height;
            this.Width = Width;
            cells = new bool[Height, Width];
            GenerateField();
        }

        private void GenerateField()
        {
            var generator = new Random();
            for (int i = 0; i < Height; i++)
            {
                for (int j= 0; j < Width; j++)
                {
                    cells[i,j] = generator.Next(2) == 1;
                }
            }
        }

        private int GetNeighbours(int x, int y)
        {
            int numOfAliveNeighbours = 0;

            for (int i = x - 1; i <= x + 1; i++)
            {
                for (int j = y - 1; j < y + 1; j++)
                {
                    if(i == x && j == y) 
                    {
                        continue;
                    }

                    if (i >= 0 && j >= 0 && i < Height && j < Width && cells[i, j])
                    {
                        numOfAliveNeighbours++;
                    }
                }
            }

            return numOfAliveNeighbours;
        }

        public void Update()
        {
            bool[,] nextGen = new bool[Height, Width];
            for (int i = 0; i < Height; i++)
            {
                for (int j = 0; j < Width; j++)
                {
                    int numOfAliveNeighbours = GetNeighbours(i,j);

                    if(cells[i,j])
                    {
                        if(numOfAliveNeighbours < 2 || numOfAliveNeighbours > 3)
                        {
                            nextGen[i, j] = false;
                        }
                        else
                        {
                            nextGen[i, j] = true;
                        }
                    }

                    else
                    {
                        if(numOfAliveNeighbours == 3)
                        {
                            nextGen[i, j] = true;
                        }
                    }
                }
            }
            cells = nextGen;
        }
        
        public GH_Structure<GH_Point> GetAliveCellsAsPoints(double cellSize)
        {
            var output = new GH_Structure<GH_Point>();
            
            for (int i = 0; i < Height; i++)
            {
                for (int j = 0; j < Width; j++)
                {
                    if (cells[i, j])
                    {
                        var point = new Point3d(i * cellSize, j * cellSize, 0);
                        output.Append(new GH_Point(point), new GH_Path(0));
                    }
                }
            }
            
            return output;
        }
    }
}
# ---------- end c_script ----------
panel = Panel(c_script.a)
